vi "RiskReduction2.gvi"   [LabVIEW NXG 2.0.0]
panel controls:
  "Numeric": f64
  "Numeric_3": f64
panel indicators:
  "Numeric_2": f64
  "Numeric_4": f64
diagram:
  Add($Numeric_3, 5) -> w1
  $Numeric_4 <- w1
  Add($Numeric, 5) -> w2
  Multiply(w2, 2) -> w3
  $Numeric_2 <- w3
